test file "sltestThrottlePositionControlTests"
  coverage: Decision, MCDC, Condition

suite "sltestThrottlePositionControlCompositionExample"

  case "BasicSchedulerTest" [equivalence]
    simulation 1:
      model sltestThrottlePositionControlCompositionExample, harness BasicSchedulerTest
    simulation 2:
      model sltestThrottlePositionControlCompositionExample, harness BasicSchedulerTest
      post-load callback:
        set_param('sltestThrottlePositionControlCompositionExample/Controller', 'SimulationMode', 'Software-in-the-loop (SIL)');
        set_param('sltestThrottlePositionControlCompositionExample/Controller', 'CodeInterface', 'Top model');
    equivalence criteria
      sltestThrottlePositionControlCompositionExample:1